# Grasshopper definition gh_validation_grids.gh (Grasshopper 1.0.7)
# plug-ins: Grasshopper-ARCHICAD Live Connection built for Rhinoceros 6

grid = Object([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])
deobject = DeconstructObject(Object=grid)  # -> AnchorPoint, Brep, ObjectSettings
extobjset = ExtractObjectSettings(ObjectSettings=deobject.ObjectSettings)  # -> LibraryPart, degrees(Angle), Layer, HomeStory, ID, StructuralFunction, Position, RenovationStatus, PropertySettings
# Home Stories
panel = Panel(extobjset.HomeStory)
# Dimensions
panel_2 = Panel(deobject.AnchorPoint)
# Angles
panel_3 = Panel(extobjset.Angle)
# Layers
panel_4 = Panel(extobjset.Layer)
# Renovation Statuses
panel_5 = Panel(extobjset.RenovationStatus)
